# Grasshopper definition preliminaryWorkflow.gh (Grasshopper 1.0.7)
# plug-ins: Helianthus, Bifocals

crop_data = Panel("/Users/albalombardiaalonso/Desktop/ASD_PHD/RESEARCH PROJECT/GH TOOL/MVP/DLI_DATA/CROPS_MVP.csv")
surface_solar_radiation = Panel("1615.836658")
Z = Slider(0.065, range=0..1)
X = Slider(1, range=0..1)
Y = Slider(0, range=0..1)
sunlightdli = SunlightDLI(SurfaceSolarRadiation=surface_solar_radiation)  # -> Out, SurfaceDLI
importcropdata = ImportCropData(CropDataCSV=crop_data)
construct_point = ConstructPoint(XCoordinate=X, YCoordinate=Y, ZCoordinate=Z)
scale = Slider(5, range=-1.001..10)
background = Slider(70, range=0..100)
legendparameters = LegendParameters(GraphOffset=construct_point, GraphScale=scale, GraphBackgroundTransparency=background)  # -> Out, LegendParameters
surface_dli = Panel(sunlightdli.SurfaceDLI)
input_values = Panel(sunlightdli.Out)
dli_suitability = DLI_Suitability(SurfaceDLI=sunlightdli.SurfaceDLI, CropDataList=importcropdata, MaterialTransmittance=0.65)  # -> Out, FilteredCropList, SurfaceDLI
geometry = Geometry(<brep referenced from the Rhino model>)
# NON FILTERED-CROPS
sitespecificcropvisualization = SiteSpecificCropVisualization(
    CropsToVisualize=importcropdata,
    SurfaceDLI=dli_suitability.SurfaceDLI,
    SurfaceGeometry=geometry,
    LegendParameters=legendparameters.LegendParameters)  # -> Graph, SurfaceDLI_Constant
input_values_2 = Panel(dli_suitability.Out)
# FILTERED-CROPS
sitespecificcropvisualization_2 = SiteSpecificCropVisualization(
    CropsToVisualize=dli_suitability.FilteredCropList,
    SurfaceDLI=dli_suitability.SurfaceDLI,
    SurfaceGeometry=geometry,
    LegendParameters=legendparameters.LegendParameters)  # -> Graph, SurfaceDLI_Constant
